# Grasshopper definition 533-w2-yiwei.gh (Grasshopper 1.0.7)

rectangle = Rectangle(Plane=PlaneXY(0, 0, 0), XSize=Slider(0.1, range=0..2), YSize=Slider(1, range=0..2), Radius=Slider(0.02, range=0..100))  # -> Rectangle, Length
vector_xyz = VectorXYZ(XComponent=Slider(0.5, range=0..4), YComponent=Slider(0, range=0..4), ZComponent=0)  # -> Vector, Length
move = Move(Geometry=rectangle.Rectangle, Motion=vector_xyz.Vector)  # -> Geometry, Transform
point = Point(Point(0, 0, 0))
polar_array = PolarArray(Geometry=move.Geometry, Plane=PlaneXY(0, 0, 0), Count=Slider(3, range=0..10), Angle=6.283185307)  # -> Geometry, Transform
polygon = Polygon(Plane=point, Radius=Slider(1, range=0..1.5), Segments=Slider(6, range=0..12), FilletRadius=Slider(0.1, range=0..100))  # -> Polygon, Length
radians = Radians(Degrees=Slider(0, range=0..100))
rotate = Rotate(Geometry=polygon.Polygon, Angle=radians, Plane=PlaneXY(0, 0, 0))  # -> Geometry, Transform
trim_with_regions = TrimWithRegions(Curve=polar_array.Geometry, Regions=rotate.Geometry)  # -> flatten(Inside), Outside
trim_with_regions_2 = TrimWithRegions(Curve=rotate.Geometry, Regions=polar_array.Geometry)  # -> Inside, Outside
join_curves = JoinCurves(Curves=[trim_with_regions_2.Outside, trim_with_regions.Inside], Preserve=False)
